# Dynamo graph meshout.dyn (Dynamo 1.3.1.1736)

code_block = CodeBlock { 4; }
byLengths = Cuboid.ByLengths(width=code_block)  # frozen
string = StringInput("C:\Revit\MIT VR Hackathon\mesh.obj")
create = List.Create(string)
select_model_element = DSModelElementSelection()  # 1 picked in the model
geometry = Element.Geometry(select_model_element)
firstItem = List.FirstItem(geometry)
byGeometry = Autodesk.Dynamo.MeshToolkit.Mesh.ByGeometry(firstItem)
create_2 = List.Create(byGeometry)
exportMeshes = Autodesk.Dynamo.MeshToolkit.Mesh.ExportMeshes(create, create_2)
union = Solid.Union()  # unwired: arg0, arg1
